# Grasshopper definition Pattern.gh (Grasshopper 1.0.7)
# plug-ins: Parakeet, Kangaroo2 Components

radius = Slider(7, range=5..20)
count = Slider(20, range=2..20)
length = GetNumber(radius, AtLeast=1, AtMost=1, Maximum=1.797693135e+308, Minimum=-1.797693135e+308, TreeAccess=False)
width = GetNumber(count, AtLeast=1, AtMost=1, Maximum=1.797693135e+308, Minimum=-1.797693135e+308, TreeAccess=False)
_2_uniform_tiling_b = _2UniformTilingB(Plane=PlaneXY(0, 0, 0), Size=1, ExtendX=length, ExtendY=width)
scale = GetNumber(Slider(0.75, range=0..1), AtLeast=1, AtMost=1, Maximum=1.797693135e+308, Minimum=-1.797693135e+308, TreeAccess=False)
area = Area(Geometry=_2_uniform_tiling_b)  # -> Area, Centroid
scale_2 = Scale(Geometry=_2_uniform_tiling_b, Center=area.Centroid, Factor=scale)  # -> Geometry, Transform
eval = Evaluate(F="50/x*y", x=area.Area, y=Slider(0.009, range=0..1))
Z = UnitZ(Factor=eval)
extr = Extrude(Base=scale_2.Geometry, Direction=Z)
cap = CapHoles(Brep=extr)
clean = CombineClean(Meshes=cap)
context_bake = ContextBake(Geometry=clean)
