# Grasshopper definition box.gh (Grasshopper 1.0.7)

nº_buildings = Slider(40, range=15..40)
number_slider = Slider(25, range=0..50)
rectangle = Rectangle(Plane=PlaneXY(0, 0, 0), XSize=number_slider, YSize=number_slider, Radius=0)  # -> Rectangle, Length
nos = GetInteger(nº_buildings, AtLeast=1, AtMost=1, Maximum=2147483647, Minimum=-2147483648, TreeAccess=False)
boundary = BoundarySurfaces(Edges=rectangle.Rectangle)
popgeo = PopulateGeometry(Geometry=boundary, Count=nos, Seed=1)
sph = Sphere(Base=popgeo, Radius="3")
context_bake = ContextBake(Geometry=sph)
