# Grasshopper definition NewFC2.gh (Grasshopper 1.0.7)

number_slider = Slider(20, range=0..100)
number_slider_2 = Slider(1, range=0..1)
length = GetNumber(number_slider, AtLeast=1, AtMost=1, Maximum=1.797693135e+308, Minimum=-1.797693135e+308, TreeAccess=False)
Y = UnitY(Factor=1)
line = LineSDL(Start="0,0,0", Direction=Y, Length=length)
multiplication = Multiplication(A=number_slider, B=Slider(0.25, range=0..1))
series = Series(Start=number_slider_2, Step=number_slider_2, Count=length)
multiplication_2 = Multiplication(A=number_slider, B=Slider(0.75, range=0..1))
X = UnitX(Factor=series)
move = Move(Geometry=line, Motion=X)  # -> Geometry, Transform
pt = ConstructPoint(XCoordinate=multiplication_2, YCoordinate=multiplication_2, ZCoordinate=Slider(0, range=0..10))
pt_2 = ConstructPoint(XCoordinate=multiplication, YCoordinate=multiplication, ZCoordinate=Slider(0, range=0..10))
divide = DivideCurve(Curve=move.Geometry, Count=length, Kinks=False)  # -> Points, Tangents, Parameters
merge = Merge(Data1=pt_2, Data2=pt)
cp = ClosestPoint(Point=divide.Points, Cloud=merge)  # -> ClosestPoint, CPIndex, Distance
division = Division(A=cp.Distance, B=Slider(2, range=0..5))
Z = UnitZ(Factor=division)
neg = Negative(Value=Z)
move_2 = Move(Geometry=divide.Points, Motion=neg)  # -> Geometry, Transform
pline = PolyLine(Vertices=move_2.Geometry, Closed=False)
pline_2 = PolyLine(Vertices=divide.Points, Closed=False)
end = EndPoints(Curve=pline_2)  # -> Start, End
end_2 = EndPoints(Curve=pline)  # -> Start, End
ln = Line(StartPoint=end.End, EndPoint=end_2.End)
ln_2 = Line(StartPoint=end.Start, EndPoint=end_2.Start)
boundary = BoundarySurfaces(Edges=[pline_2, ln_2, pline, ln])
X_2 = UnitX(Factor=Slider(0.3, range=0.1..0.9))
extr = Extrude(Base=boundary, Direction=X_2)

# ---- group: RH_OUT:FC
mesh = Mesh(extr)

# ----
context_bake = ContextBake(Geometry=mesh)
