# Grasshopper definition rnd_node.gh (Grasshopper 1.0.7)

move = GetNumber(Slider(1, range=1..10), AtLeast=1, AtMost=10, Maximum=1.797693135e+308, Minimum=-1.797693135e+308, TreeAccess=False)
radius = GetNumber(Slider(7, range=7..20), AtLeast=7, AtMost=20, Maximum=1.797693135e+308, Minimum=-1.797693135e+308, TreeAccess=False)
unit_y = UnitY(Factor=move)
plane = Plane(unit_y)
sphere = Sphere(NumberSlider=plane, Radius=radius)
context_bake = ContextBake(Geometry=sphere)
