# Grasshopper definition test2.gh (Grasshopper 1.0.7)

move = GetNumber(Slider(1, range=1..10), AtLeast=1, AtMost=10, Maximum=10, Minimum=1, TreeAccess=False)
radius = GetNumber(Slider(15, range=1..20), AtLeast=1, AtMost=20, Maximum=20, Minimum=1, TreeAccess=False)
unit_y = UnitY(Factor=move)
plane = Plane(unit_y)
sphere = Sphere(NumberSlider=plane, Radius=radius)
mesh = Mesh(sphere)
context_bake = ContextBake(Geometry=mesh)
