# Grasshopper definition script_R3.gh (Grasshopper 1.0.7)

number_slider = Slider(2, range=0..10000)
l_extent_x = GetInteger(Slider(5, range=1..10), AtLeast=1, AtMost=1, Maximum=10, Minimum=1, TreeAccess=False)
l_extent_y = GetInteger(Slider(6, range=1..10), AtLeast=1, AtMost=1, Maximum=10, Minimum=1, TreeAccess=False)
find_assemblies = GhPythonScript()  # -> out
# ---------- find_assemblies: Python ----------
import Grasshopper as gh

this = ghenv.Component
thisDoc = this.OnPingDocument()

asms = []

for obj in thisDoc.Objects:
    #print obj.GetType().BaseType
    
    #if obj.Obsolete: print 'Warning: Obsolete'
    #print 'Name: {}\nDescription: {}\nCategory: {} -> {}\n '.format(obj.Name, obj.Description, obj.Category, obj.SubCategory)
    #print 'Pivot: {} \t Bounds: {}'.format(obj.Attributes.Pivot, obj.Attributes.Bounds)
    
    asm = gh.Instances.ComponentServer.FindAssemblyByObject(obj.ComponentGuid)
    
    #print(x.IsCoreLibrary)
    if asm is not None and not asm.IsCoreLibrary:
        asms.append(asm.Name)
    
print asms
# ---------- end find_assemblies ----------
panel = Panel(find_assemblies)
hexagonal = Hexagonal(Plane=PlaneXY(0, 0, 0), Size=number_slider, ExtentX=l_extent_x, ExtentY=l_extent_y)  # -> simplify(flatten(Cells)), Points
geometry = Geometry(hexagonal.Cells)
list_item = ListItem(List=hexagonal.Cells, Index=Slider(12, range=1..25), Wrap=True)
division = Division(A=Slider(1, range=0..10), B=Slider(3, range=0..10))
curve = Curve(geometry)
multiplication = Multiplication(A=number_slider, B=division)
area = Area(Geometry=list_item)  # -> Area, Centroid
s_extent_x = GetInteger(Slider(6, range=1..10), AtLeast=1, AtMost=1, Maximum=10, Minimum=1, TreeAccess=False)
s_extent_y = GetInteger(Slider(7, range=1..10), AtLeast=1, AtMost=1, Maximum=10, Minimum=1, TreeAccess=False)
cluster_a_position = GetInteger(Slider(37, range=1..99), AtLeast=1, AtMost=1, Maximum=99, Minimum=1, TreeAccess=False)
cluster_b_position = GetInteger(Slider(35, range=1..99), AtLeast=1, AtMost=1, Maximum=99, Minimum=1, TreeAccess=False)
division_2 = Division(A=number_slider, B=Slider(10, range=0..10))
hexagonal_2 = Hexagonal(Plane=area.Centroid, Size=multiplication, ExtentX=s_extent_x, ExtentY=s_extent_y)  # -> simplify(flatten(Cells)), Points
multiplication_2 = Multiplication(A=division_2, B=Slider(0.15, range=0..1))
list_item_2 = ListItem(List=hexagonal_2.Cells, Index=[cluster_a_position, cluster_b_position], Wrap=True)
number_slider_2 = Slider(250, range=0..1000)
subtraction = Subtraction(A=division_2, B=multiplication_2)
divide_curve = DivideCurve(Curve=list_item_2, Count=Slider(12, range=0..100), Kinks=False)  # -> Points, Tangents, Parameters
polygon = Polygon(Plane=divide_curve.Points, Radius=subtraction, Segments=6, FilletRadius=0)  # -> Polygon, Length
rotate = Rotate(Geometry=polygon.Polygon, Angle=degrees(Slider(90, range=0..100)), Plane=divide_curve.Points)  # -> Geometry, Transform
curve_2 = Curve(hexagonal_2.Cells)
multiplication_3 = Multiplication(A=subtraction, B=Slider(0.8, range=0..1))
custom_preview = CustomPreview(Geometry=rotate.Geometry, Material=ColourSwatch(SwatchColor=RGB(0, 0, 0)))
circle = Circle(Plane=divide_curve.Points, Radius=multiplication_3)
curve_3 = Curve(rotate.Geometry)
context_bake = ContextBake(Grid_small=curve_2)
curve_4 = Curve(circle)
context_bake_2 = ContextBake(Grid_large=curve)
context_bake_3 = ContextBake(Cluster_circles=curve_4)
context_bake_4 = ContextBake(Geometry=curve_3)
