# Grasshopper definition Twist.gh (Grasshopper 1.0.7)

initial_radius = GetInteger(Slider(68, range=0..100), AtLeast=1, AtMost=1, Maximum=2147483647, Minimum=-2147483648, TreeAccess=False)
fillet_radius = GetInteger(
    Slider(7, range=0..25),
    AtLeast=1,
    AtMost=1,
    Maximum=2147483647,
    Minimum=-2147483648,
    Prompt="Set Fillet Radius (Default:3, 0 is no Fillet)",
    TreeAccess=False)
length = GetInteger(
    Slider(594, range=0..1000),
    AtLeast=1,
    AtMost=1,
    Maximum=2147483647,
    Minimum=-2147483648,
    Prompt="Set Length",
    TreeAccess=False)
rotation = GetInteger(
    Slider(90, range=0..360),
    AtLeast=1,
    AtMost=1,
    Maximum=2147483647,
    Minimum=-2147483648,
    Prompt="Set Rotation of End, Middle will be Half",
    TreeAccess=False)
scale_factor = GetNumber(Slider(1.5, range=0.5..2.5), AtLeast=1, AtMost=1, Maximum=1.797693135e+308, Minimum=-1.797693135e+308, TreeAccess=False)
xz = XZPlane(Origin=Point(0, 0, 0))
division = Division(A=length, B="2")
merge = Merge(Data1=division, Data2=length)
polygon = Polygon(Plane=xz, Radius=initial_radius, Segments=6, FilletRadius=fillet_radius)  # -> Polygon, Length
Y = UnitY(Factor=merge)
move = Move(Geometry=polygon.Polygon, Motion=Y)  # -> Geometry, Transform
dispatch = Dispatch(List=move.Geometry, DispatchPattern=[True, False])  # -> ListA, ListB
multiplication = Multiplication(A=rotation, B="2")
rotate = Rotate(Geometry=dispatch.ListB, Angle=degrees(multiplication), Plane=xz)  # -> Geometry, Transform
rotate_2 = Rotate(Geometry=dispatch.ListA, Angle=degrees(rotation), Plane=xz)  # -> Geometry, Transform
area = Area(Geometry=rotate.Geometry)  # -> Area, Centroid
area_2 = Area(Geometry=rotate_2.Geometry)  # -> Area, Centroid
division_2 = Division(A=scale_factor, B="1.5")
scale = Scale(Geometry=rotate.Geometry, Center=area.Centroid, Factor=scale_factor)  # -> Geometry, Transform
scale_2 = Scale(Geometry=rotate_2.Geometry, Center=area_2.Centroid, Factor=division_2)  # -> Geometry, Transform
merge_2 = Merge(Data1=polygon.Polygon, Data2=scale_2.Geometry, Data3=scale.Geometry)
loft = Loft(Curves=merge_2, Options={Adjust=False, Closed=False, LoftEnds=0, LoftSimp=0, LoftType=0, Rebuild=10, Refit=0.01})
cap = CapHoles(Brep=loft)
mesh = MeshBrep(
    Brep=cap,
    Settings={GridMaxCount=0, GridMinCount=16, JaggedSeams=False, MaxEdgeLength=0, MinEdgeLength=0.0001, MinTolerance=0, Refine=True, RefineAngle=0, RelativeTolerance=0.65, SimplePlanes=True, Tolerance=0})
demesh = DeconstructMesh(Mesh=mesh)  # -> Vertices, Faces, Colours, Normals
conmesh = ConstructMesh(Vertices=demesh.Vertices, Faces=demesh.Faces, Colours=ColourSwatch(SwatchColor=RGB(27, 239, 39)))

# ---- group: RH_OUT:Twist
context_bake = ContextBake(Geometry=conmesh)
