# Grasshopper definition Assignment_ziqi cui.gh (Grasshopper 1.0.7)
# plug-ins: Kangaroo2 Components, Karamba3D, Pufferfish

number_slider = Slider(1, range=0..1)
hexagonal = Hexagonal(Plane=PlaneXY(0, 0, 0), Size=Slider(5, range=0..10), ExtentX=number_slider, ExtentY=number_slider)  # -> Cells, Points
curve = Curve(hexagonal.Cells)
explode = Explode(Curve=curve, Recursive=Toggle(False))  # -> Segments, Vertices
list_item = ListItem(List=explode.Vertices, Index=0, Wrap=True)  # -> Item, Item1, Item2, Item3, Item4, Item5
area = Area(Geometry=curve)  # -> Area, Centroid
line = Line(StartPoint=list_item.Item, EndPoint=list_item.Item3)
line_2 = Line(StartPoint=list_item.Item1, EndPoint=list_item.Item4)
line_3 = Line(StartPoint=list_item.Item2, EndPoint=list_item.Item5)
point = Point(flatten([area.Centroid, list_item.Item, list_item.Item1, list_item.Item2, list_item.Item3, list_item.Item4, list_item.Item5]))

B = Slider(0.1, range=0..1)
number_slider_2 = Slider(0.1, range=0..1)
A = Slider(0.1, range=0..1)
C = Slider(0.1, range=0..1)
number_slider_3 = Slider(0.1, range=0..1)
number_slider_4 = Slider(0.1, range=0..1)

number_slider_5 = Slider(40, range=0..100)
oa = GetNumber(A, AtLeast=1, AtMost=1, Maximum=1.797693135e+308, Minimum=-1.797693135e+308)
ob = GetNumber(number_slider_2, AtLeast=1, AtMost=1, Maximum=1.797693135e+308, Minimum=-1.797693135e+308)
oc = GetNumber(B, AtLeast=1, AtMost=1, Maximum=1.797693135e+308, Minimum=-1.797693135e+308)
oe = GetNumber(C, AtLeast=1, AtMost=1, Maximum=1.797693135e+308, Minimum=-1.797693135e+308)
of = GetNumber(number_slider_4, AtLeast=1, AtMost=1, Maximum=1.797693135e+308, Minimum=-1.797693135e+308)
od = GetNumber(number_slider_3, AtLeast=1, AtMost=1, Maximum=1.797693135e+308, Minimum=-1.797693135e+308)
divide_curve = DivideCurve(Curve=line, Count=number_slider_5, Kinks=False)  # -> Points, Tangents, Parameters
pline = PolyLine(Vertices=divide_curve.Points, Closed=False)
divide_curve_2 = DivideCurve(Curve=line_3, Count=number_slider_5, Kinks=False)  # -> Points, Tangents, Parameters
divide_curve_3 = DivideCurve(Curve=line_2, Count=number_slider_5, Kinks=False)  # -> Points, Tangents, Parameters
list_item_2 = ListItem(List=divide_curve_2.Points, Index=Slider(0, range=0..10), Wrap=True)
end = EndPoints(Curve=pline)  # -> Start, End
point_2 = Point(end.End)
pline_2 = PolyLine(Vertices=divide_curve_3.Points, Closed=False)
pline_3 = PolyLine(Vertices=divide_curve_2.Points, Closed=False)
point_3 = Point(end.Start)
end_2 = EndPoints(Curve=pline_2)  # -> Start, End
end_3 = EndPoints(Curve=pline_3)  # -> Start, End
vec2pt = Vector2Pt(PointA=end.End, PointB=end.Start, Unitize=False)  # -> Vector, Length
vec2pt_2 = Vector2Pt(PointA=end.Start, PointB=end.End, Unitize=False)  # -> Vector, Length
number_slider_6 = Slider(92, range=0..610)
number_slider_7 = Slider(92, range=0..610)
multiplication = Multiplication(A=vec2pt.Vector, B=ob)
number_slider_8 = Slider(92, range=0..610)
vec2pt_3 = Vector2Pt(PointA=end_3.Start, PointB=end_3.End, Unitize=False)  # -> Vector, Length
vec2pt_4 = Vector2Pt(PointA=end_3.End, PointB=end_3.Start, Unitize=False)  # -> Vector, Length
vec2pt_5 = Vector2Pt(PointA=end_2.End, PointB=end_2.Start, Unitize=False)  # -> Vector, Length
vec2pt_6 = Vector2Pt(PointA=end_2.Start, PointB=end_2.End, Unitize=False)  # -> Vector, Length
multiplication_2 = Multiplication(A=vec2pt_2.Vector, B=oa)
Z = UnitZ(Factor=expr("-x", number_slider_6))
box = CenterBox(Base=PlaneXY(0, 0, 0), X=number_slider_6, Y=number_slider_6, Z=number_slider_6)
box_2 = CenterBox(Base=PlaneXY(0, 0, 0), X=number_slider_7, Y=number_slider_7, Z=number_slider_7)
Z_2 = UnitZ(Factor=expr("-x", number_slider_7))
move = Move(Geometry=end.End, Motion=multiplication)  # -> Geometry, Transform
multiplication_3 = Multiplication(A=vec2pt_5.Vector, B=od)
multiplication_4 = Multiplication(A=vec2pt_3.Vector, B=oe)
multiplication_5 = Multiplication(A=vec2pt_4.Vector, B=of)
multiplication_6 = Multiplication(A=vec2pt_6.Vector, B=oc)
box_3 = CenterBox(Base=PlaneXY(0, 0, 0), X=number_slider_8, Y=number_slider_8, Z=number_slider_8)
Z_3 = UnitZ(Factor=expr("-x", number_slider_8))
explode_2 = Explode(Curve=pline, Recursive=True)  # -> Segments, Vertices
move_2 = Move(Geometry=end_3.Start, Motion=multiplication_4)  # -> Geometry, Transform
explode_3 = Explode(Curve=pline_2, Recursive=True)  # -> Segments, Vertices
move_3 = Move(Geometry=end.Start, Motion=multiplication_2)  # -> Geometry, Transform
move_4 = Move(Geometry=box_2, Motion=Z_2)  # -> Geometry, Transform
move_5 = Move(Geometry=end_2.End, Motion=multiplication_3)  # -> Geometry, Transform
move_6 = Move(Geometry=box, Motion=Z)  # -> Geometry, Transform
move_7 = Move(Geometry=end_2.Start, Motion=multiplication_6)  # -> Geometry, Transform
explode_4 = Explode(Curve=pline_3, Recursive=True)  # -> Segments, Vertices
move_8 = Move(Geometry=box_3, Motion=Z_3)  # -> Geometry, Transform
move_9 = Move(Geometry=end_3.End, Motion=multiplication_5)  # -> Geometry, Transform
rod = Rod(Polyline=pline_2, LengthFactor=1, AngleFactor=1, AxialStrength=10, BendStrength=1)
length_line = LengthLine(Line=pline_2, Strength=10)
load = Load(Point=[end_2.Start, end_2.End], ForceVector=Vector(0, 0, 1), Weighting=1)
spc = SolidPointCollide(Points=explode_3.Vertices, Solid=move_4.Geometry, Interior=False, Unidirectional=True, Strength=1)
anchor = Anchor(Point=end_2.End, Target=move_5.Geometry, Strength=10000)
rod_2 = Rod(Polyline=pline_3, LengthFactor=1, AngleFactor=1, AxialStrength=10, BendStrength=1)
anchor_2 = Anchor(Point=end.End, Target=move.Geometry, Strength=10000)
anchor_3 = Anchor(Point=end_2.Start, Target=move_7.Geometry, Strength=10000)
anchor_4 = Anchor(Point=end_3.Start, Target=move_2.Geometry, Strength=10000)
length_line_2 = LengthLine(Line=pline, Strength=10)
anchor_5 = Anchor(Point=end.Start, Target=move_3.Geometry, Strength=10000)
length_line_3 = LengthLine(Line=pline_3, Strength=10)
anchor_6 = Anchor(Point=end_3.End, Target=move_9.Geometry, Strength=10000)
load_2 = Load(Point=[end_3.Start, end_3.End], ForceVector=Vector(0, 0, 1), Weighting=1)
spc_2 = SolidPointCollide(Points=explode_4.Vertices, Solid=move_8.Geometry, Interior=False, Unidirectional=True, Strength=1)
rod_3 = Rod(Polyline=pline, LengthFactor=1, AngleFactor=1, AxialStrength=10, BendStrength=1)
spc_3 = SolidPointCollide(Points=explode_2.Vertices, Solid=move_6.Geometry, Interior=False, Unidirectional=True, Strength=1)
merge = Merge(Data1=anchor_3, Data2=anchor, Data3=load, Data4=length_line, Data5=rod, Data6=spc)
merge_2 = Merge(Data1=anchor_4, Data2=anchor_6, Data3=load_2, Data4=length_line_3, Data5=rod_2, Data6=spc_2)
merge_3 = Merge(Data1=anchor_5, Data2=anchor_2, Data3=length_line_2, Data4=rod_3, Data5=spc_3)
zombiesolver = ZombieSolver(GoalObjects=[merge_3, merge, merge_2], Threshold=1e-10, Tolerance=0.0001, MaxIterations=50000)  # -> I, V, O
panel = Panel("""2
7
12""")
curve_2 = Curve(zombiesolver.O)
point_4 = Point(zombiesolver.V)
cull_index = CullIndex(List=curve_2, Indices=panel, Wrap=True)
clean_tree = CleanTree(RemoveNulls=True, RemoveInvalid=True, RemoveEmpty=False, Tree=cull_index)
list_length = ListLength(List=clean_tree)
division = Division(A=list_length, B=Slider(3, range=0..10))
number_slider_9 = Slider(21, range=0..21)
number_slider_10 = Slider(21, range=0..21)
number_slider_11 = Slider(21, range=0..21)
integer = Integer(division)
partition_list = PartitionList(List=clean_tree, Size=integer)
explode_tree = ExplodeTree(Data=partition_list)  # -> _00000000, _00000001, _00000002
end_points = EndPoints(Curve=explode_tree._00000000)  # -> Start, End
end_points_2 = EndPoints(Curve=explode_tree._00000001)  # -> Start, End
end_points_3 = EndPoints(Curve=explode_tree._00000002)  # -> Start, End
remove_duplicate_points_karamba3d = RemoveDuplicatePointsKaramba3D(Point=[end_points.Start, end_points.End], LimitDistance=0.005)  # -> OutPoint, Info, Indexes

list_length_2 = ListLength(List=remove_duplicate_points_karamba3d.OutPoint)
division_2 = Division(A=list_length_2, B=Slider(2, range=0..10))
subtraction = Subtraction(A=division_2, B=Slider(1, range=0..1))
split_list = SplitList(List=remove_duplicate_points_karamba3d.OutPoint, Index=subtraction)  # -> ListA, ListB
point_5 = Point(split_list.ListB)

remove_duplicate_points_karamba3d_2 = RemoveDuplicatePointsKaramba3D(Point=[end_points_2.Start, end_points_2.End], LimitDistance=0.005)  # -> OutPoint, Info, Indexes

list_length_3 = ListLength(List=remove_duplicate_points_karamba3d_2.OutPoint)
division_3 = Division(A=list_length_3, B=Slider(2, range=0..10))
subtraction_2 = Subtraction(A=division_3, B=Slider(1, range=0..1))
split_list_2 = SplitList(List=remove_duplicate_points_karamba3d_2.OutPoint, Index=subtraction_2)  # -> ListA, ListB
point_6 = Point(split_list_2.ListB)

remove_duplicate_points_karamba3d_3 = RemoveDuplicatePointsKaramba3D(Point=[end_points_3.Start, end_points_3.End], LimitDistance=0.005)  # -> OutPoint, Info, Indexes

list_length_4 = ListLength(List=remove_duplicate_points_karamba3d_3.OutPoint)
division_4 = Division(A=list_length_4, B=Slider(2, range=0..10))
subtraction_3 = Subtraction(A=division_4, B=Slider(1, range=0..1))
split_list_3 = SplitList(List=remove_duplicate_points_karamba3d_3.OutPoint, Index=subtraction_3)  # -> ListA, ListB
point_7 = Point(split_list_3.ListB)

split_list_4 = SplitList(List=split_list.ListA, Index=number_slider_9)  # -> ListA, ListB
split_list_5 = SplitList(List=point_5, Index=Slider(1, range=0..100))  # -> ListA, ListB
split_list_6 = SplitList(List=split_list_2.ListA, Index=number_slider_10)  # -> ListA, ListB
split_list_7 = SplitList(List=split_list_3.ListA, Index=number_slider_11)  # -> ListA, ListB
split_list_8 = SplitList(List=point_6, Index=Slider(1, range=0..100))  # -> ListA, ListB
split_list_9 = SplitList(List=split_list_5.ListB, Index=number_slider_9)  # -> ListA, ListB
point_list = PointList(Points=split_list_4.ListA, Size=Slider(0.2, range=0..1))
split_list_10 = SplitList(List=point_7, Index=Slider(1, range=0..100))  # -> ListA, ListB
split_list_11 = SplitList(List=split_list_10.ListB, Index=number_slider_11)  # -> ListA, ListB
split_list_12 = SplitList(List=split_list_8.ListB, Index=number_slider_10)  # -> ListA, ListB
point_list_2 = PointList(Points=split_list_9.ListA, Size=Slider(0.2, range=0..1))
point_list_3 = PointList(Points=split_list_12.ListA, Size=Slider(0.2, range=0..1))
point_list_4 = PointList(Points=split_list_11.ListA, Size=Slider(0.2, range=0..1))
point_list_5 = PointList(Points=split_list_6.ListA, Size=Slider(0.2, range=0..1))
point_list_6 = PointList(Points=split_list_7.ListA, Size=Slider(0.2, range=0..1))
reverse_list = ReverseList(List=split_list_3.ListA)
reverse_list_2 = ReverseList(List=split_list_10.ListB)
list_item_3 = ListItem(List=split_list_4.ListA, Index=0, Wrap=True)
reverse_list_3 = ReverseList(List=split_list_2.ListA)
list_item_4 = ListItem(List=split_list_9.ListA, Index="19", Wrap=True)
reverse_list_4 = ReverseList(List=split_list_8.ListB)
list_item_5 = ListItem(List=split_list_6.ListA, Index=0, Wrap=True)
list_item_6 = ListItem(List=split_list_12.ListA, Index="19", Wrap=True)
list_item_7 = ListItem(List=split_list_7.ListA, Index=0, Wrap=True)
list_item_8 = ListItem(List=split_list_11.ListA, Index="19", Wrap=True)
loft = Loft(
    Curves=[explode_tree._00000000, explode_tree._00000001, explode_tree._00000002],
    Options={Adjust=False, Closed=False, LoftEnds=0, LoftSimp=0, LoftType=0, Rebuild=10, Refit=0.01})
line_4 = Line(StartPoint=list_item_8, EndPoint=list_item_6)
line_5 = Line(StartPoint=list_item_3, EndPoint=list_item_8)
line_6 = Line(StartPoint=list_item_6, EndPoint=list_item_4)
line_7 = Line(StartPoint=list_item_5, EndPoint=list_item_3)
line_8 = Line(StartPoint=list_item_5, EndPoint=list_item_7)
line_9 = Line(StartPoint=list_item_4, EndPoint=list_item_7)
line_10 = Line(StartPoint=split_list.ListA, EndPoint=split_list_10.ListB)
line_11 = Line(StartPoint=split_list_3.ListA, EndPoint=split_list_5.ListB)
line_12 = Line(StartPoint=split_list.ListA, EndPoint=reverse_list_3)
bounding_box = BoundingBox(Content=loft, Plane=PlaneXY(0, 0, 0))  # -> Box, Box_2
line_13 = Line(StartPoint=reverse_list_4, EndPoint=split_list_5.ListB)
line_14 = Line(StartPoint=split_list_8.ListB, EndPoint=reverse_list_2)
line_15 = Line(StartPoint=reverse_list, EndPoint=split_list_2.ListA)
boundary_surfaces = BoundarySurfaces(Edges=flatten([line_5, line_6, line_4, line_9, line_8, line_7]))
curve_3 = Curve(flatten([line_5, line_6, line_4, line_9, line_8, line_7]))
length = Length(Curve=line_11)
explode_tree_2 = ExplodeTree(Data=bounding_box.Box)  # -> _000000000, _000000010, _000000020
length_2 = Length(Curve=line_10)
length_3 = Length(Curve=line_12)
length_4 = Length(Curve=line_13)
length_5 = Length(Curve=line_14)
length_6 = Length(Curve=line_15)
custom_preview = CustomPreview(Geometry=boundary_surfaces, Material=ColourSwatch(SwatchColor=RGBA(35, 57, 61, 97)))
area_2 = Area(Geometry=boundary_surfaces)  # -> Area, Centroid
mass_addition = MassAddition(Input=length_2)  # -> Result, PartialResults
mass_addition_2 = MassAddition(Input=length_3)  # -> Result, PartialResults
mass_addition_3 = MassAddition(Input=length)  # -> Result, PartialResults
brep = Brep(explode_tree_2._000000010)
custom_preview_2 = CustomPreview(Geometry=curve_3, Material=ColourSwatch(SwatchColor=RGBA(35, 57, 61, 0)))
mass_addition_4 = MassAddition(Input=length_4)  # -> Result, PartialResults
mass_addition_5 = MassAddition(Input=length_5)  # -> Result, PartialResults
mass_addition_6 = MassAddition(Input=length_6)  # -> Result, PartialResults
deconstruct_brep = DeconstructBrep(Brep=brep)  # -> Faces, Edges, Vertices
context_bake = ContextBake(Geometry=curve_3)
line_16 = Line(StartPoint=list_item_3, EndPoint=list_item_4)
line_17 = Line(StartPoint=list_item_5, EndPoint=list_item_6)
list_item_9 = ListItem(List=deconstruct_brep.Edges, Index=Slider(11, range=0..12), Wrap=True)
line_18 = Line(StartPoint=list_item_7, EndPoint=list_item_8)
curve_4 = Curve(list_item_9)
mass_addition_7 = MassAddition(Input=flatten([mass_addition_3.Result, mass_addition.Result, mass_addition_2.Result, mass_addition_4.Result, mass_addition_6.Result, mass_addition_5.Result]))  # -> Result, PartialResults
length_7 = Length(Curve=line_16)
length_8 = Length(Curve=line_17)
length_9 = Length(Curve=curve_4)
length_10 = Length(Curve=line_18)
panel_2 = Panel(length_8)
panel_3 = Panel(length_10)

# ---- group: 直径
panel_4 = Panel(length_7)

# ----
number = Number(flatten(mass_addition_7.Result))
entwine = Entwine(Branch00=clean_tree, FlattenInputs=True)
entwine_2 = Entwine(
    Branch00=line_11,
    Branch01=line_10,
    Branch02=line_12,
    Branch03=line_13,
    Branch04=line_15,
    Branch05=line_14,
    FlattenInputs=True)

# ---- group: area(m^2)
panel_5 = Panel(area_2.Area)

# ---- group: height(m)
height = Panel(length_9)

# ---- group: total material usage(m)
panel_6 = Panel(mass_addition_7.Result)

# ---- group: AOC
panel_7 = Panel(mass_addition_3.Result)

# ---- group: A'OC'
panel_8 = Panel(mass_addition.Result)

# ---- group: BOC
panel_9 = Panel(mass_addition_6.Result)

# ---- group: AOB'
panel_10 = Panel(mass_addition_4.Result)

# ---- group: A'OB
panel_11 = Panel(mass_addition_2.Result)

# ---- group: B'OC'
panel_12 = Panel(mass_addition_5.Result)

# ----
parameter_pipe_mesh = ParameterPipeMesh(
    Curve=entwine_2,
    Radius=Slider(0.008, range=0..0.01),
    ParametersU=[0, 0.1, 0.2, 0.3, 0.4, 0.5, 0.6, 0.7, 0.8, 0.9, 1],
    ParametersV=[0, 0.25, 0.5, 0.75, 1],
    Weighted=False,
    Lengths=False,
    Angle=0,
    Rotation=0,
    EndType=0,
    Triangulate=False)  # -> flatten(Piped)
parameter_pipe_mesh_2 = ParameterPipeMesh(
    Curve=entwine,
    Radius=Slider(0.03, range=0..0.1),
    ParametersU=[0, 0.1, 0.2, 0.3, 0.4, 0.5, 0.6, 0.7, 0.8, 0.9, 1],
    ParametersV=[0, 0.25, 0.5, 0.75, 1],
    Weighted=False,
    Lengths=False,
    Angle=0,
    Rotation=0,
    EndType=0,
    Triangulate=False)  # -> flatten(Piped)
context_bake_2 = ContextBake(WovenStructure=parameter_pipe_mesh)
context_bake_3 = ContextBake(Geometry=parameter_pipe_mesh_2)
